# Grasshopper definition 12 image+dividing 2.gh (Grasshopper 1.0.7)
# plug-ins: Squid (ShapeDiver Edition), LunchBoxML, LunchBox

panel = Panel("C:\Users\ewama\Documents\GitHub\hgh\assets\TEST_IMAGE.jpg")

read = Read(Path=panel)  # -> Bitmap, Bounds
dimensions = Dimensions(Surface=read.Bounds)  # -> UDimension, VDimension

# ---- group: inputy
number_slider = Slider(20, range=0..100)
cell_selection = Slider(0, range=0..1)
amount_of_colors_for_big_panels = Slider(8, range=2..20)
amount_of_colors_for_colors = Slider(8, range=2..20)
amount_of_color_pickers = Slider(12, range=0..20)
way_of_working = BooleanToggle(True)

# ----
# area to be divided
number_slider_2 = Slider(11, range=1..100)
number_slider_3 = Slider(7, range=1..100)
value_list = ValueList({"hexagonal": 0, "diamond": 1, "rectangle": 2, "triangle": 3, "bricks": 4}, selected="rectangle")
surface = Surface(read.Bounds)

# ----
# dividing to panels
stream_gate = StreamGate(Stream=surface, Gate=value_list)  # -> Target0, Target1, Target2, Target3, Target4
diamond_panels = DiamondPanels(Surface=stream_gate.Target1, UDivisions=number_slider_2, VDivisions=number_slider_3)  # -> DiamondPanels, TriPanels
quad_panels = QuadPanels(Surface=stream_gate.Target2, UDivisions=number_slider_2, VDivisions=number_slider_3)
triangular_panels_a = TriangularPanelsA(Surface=stream_gate.Target3, UDivisions=number_slider_2, VDivisions=number_slider_3)
hexagon_cells = HexagonCells(Surface=stream_gate.Target0, UDivisions=number_slider_2, VDivisions=number_slider_3, TParameter=0.25)  # -> HexagonCells, Centers
merge = Merge(
    Data1=hexagon_cells.HexagonCells,
    Data2=[diamond_panels.DiamondPanels, diamond_panels.TriPanels],
    Data3=quad_panels,
    Data4=triangular_panels_a)  # -> simplify(Result)

output_panels = Geometry(merge)

# ----
# area to be divided
number_slider_4 = Slider(5, range=1..100)
number_slider_5 = Slider(4, range=1..100)
value_list_2 = ValueList({"hexagonal": 0, "diamond": 1, "rectangle": 2, "triangle": 3, "bricks": 4}, selected="diamond")
surface_2 = Surface(output_panels)

brep_edges = BrepEdges(Brep=output_panels)  # -> Naked, Interior, NonManifold

# ----
# dividing to cells
stream_gate_2 = StreamGate(Stream=surface_2, Gate=value_list_2)  # -> Target0, Target1, Target2, Target3, Target4
diamond_panels_2 = DiamondPanels(Surface=stream_gate_2.Target1, UDivisions=number_slider_4, VDivisions=number_slider_5)  # -> DiamondPanels, TriPanels
quad_panels_2 = QuadPanels(Surface=stream_gate_2.Target2, UDivisions=number_slider_4, VDivisions=number_slider_5)
triangular_panels_a_2 = TriangularPanelsA(Surface=stream_gate_2.Target3, UDivisions=number_slider_4, VDivisions=number_slider_5)
hexagon_cells_2 = HexagonCells(Surface=stream_gate_2.Target0, UDivisions=number_slider_4, VDivisions=number_slider_5, TParameter=0.25)  # -> HexagonCells, Centers
merge_2 = Merge(
    Data1=hexagon_cells_2.HexagonCells,
    Data2=[diamond_panels_2.DiamondPanels, diamond_panels_2.TriPanels],
    Data3=quad_panels_2,
    Data4=triangular_panels_a_2)  # -> simplify(flatten(Result))

tree_branch = TreeBranch(Tree=simplify(merge_2), Path=Slider(0, range=0..10), MaintainPaths=True)

division = Division(A=dimensions.UDimension, B=number_slider)
construct_domain² = ConstructDomain²(UMin=0, UMax=1, VMin=0, VMax=1)
division_2 = Division(A=dimensions.VDimension, B=division)
divide_domain² = DivideDomain²(Domain=construct_domain², UCount=number_slider, VCount=division_2)
isotrim = Isotrim(Surface=reparameterize(read.Bounds), Domain=divide_domain²)
list_length = ListLength(List=isotrim)
import_image = ImportImage(File=panel, Rectangle=read.Bounds)
area = Area(Geometry=output_panels)  # -> Area, Centroid
remap_numbers = RemapNumbers(Value=cell_selection, Source=Domain(0, 1), Target=list_length)  # -> Mapped, Clipped
list_item = ListItem(List=isotrim, Index=remap_numbers.Mapped, Wrap=True)
construct_domain²_2 = ConstructDomain²(UMin=0, UMax=1, VMin=0, VMax=1)
mesh_closest_point = MeshClosestPoint(Point=area.Centroid, Mesh=import_image)  # -> Point, Index, Parameter
mesh_eval = MeshEval(Mesh=import_image, Parameter=mesh_closest_point.Parameter)  # -> Point, Normal, Colour
divide_domain²_2 = DivideDomain²(Domain=construct_domain²_2, UCount=amount_of_color_pickers, VCount=amount_of_color_pickers)
surface_3 = Surface(list_item)
isotrim_2 = Isotrim(Surface=reparameterize(graft(surface_3)), Domain=divide_domain²_2)
colour = Colour(simplify(mesh_eval.Colour))
text_split = TextSplit(Text=flatten(colour), Separators=",")
area_2 = Area(Geometry=merge_2)  # -> Area, Centroid
k_means_clustering = KMeansClustering(TrainingInputs=text_split, OfClusters=amount_of_colors_for_big_panels, RandomSeed=3)  # -> Result, Likelihood, Centroids
mesh_closest_point_2 = MeshClosestPoint(Point=area_2.Centroid, Mesh=import_image)  # -> Point, Index, Parameter
mesh_eval_2 = MeshEval(Mesh=import_image, Parameter=mesh_closest_point_2.Parameter)  # -> Point, Normal, Colour
list_item_2 = ListItem(List=k_means_clustering.Centroids, Index=0, Wrap=True)  # -> Item, Item1, Item2
colour_2 = Colour(simplify(mesh_eval_2.Colour))
colour_rgb = ColourRGB(Alpha=255, Red=list_item_2.Item, Green=list_item_2.Item1, Blue=list_item_2.Item2)  # -> flatten(Colour)
text_split_2 = TextSplit(Text=colour_2, Separators=",")
list_item_3 = ListItem(List=colour_rgb, Index=k_means_clustering.Result, Wrap=True)
dispatch = Dispatch(List=surface_2, DispatchPattern=way_of_working)  # -> ListA, ListB
dispatch_2 = Dispatch(List=list_item_3, DispatchPattern=way_of_working)  # -> ListA, ListB
dispatch_3 = Dispatch(List=tree_branch, DispatchPattern=way_of_working)  # -> ListA, ListB

clean_tree = CleanTree(RemoveNulls=True, RemoveInvalid=True, RemoveEmpty=True, Tree=text_split_2)
panel_2 = Panel(clean_tree)
area_3 = Area(Geometry=dispatch_3.ListA)  # -> Area, Centroid

# ----
# points to be divided to surfaces
point = Point(area_3.Centroid)

pull_point = PullPoint(Point=flatten(point), Geometry=simplify(graft(output_panels)), ClosestOnly=True)  # -> ClosestPoint, simplify(Distance)
smaller_than = SmallerThan(FirstNumber=pull_point.Distance, SecondNumber="0.0001")  # -> SmallerThan, OrEqualTo
dispatch_4 = Dispatch(List=simplify(pull_point.ClosestPoint), DispatchPattern=smaller_than.SmallerThan)  # -> ListA, ListB

output_points_divided_to_surfaces = Geometry(dispatch_4.ListA)
flip_matrix = FlipMatrix(Data=output_points_divided_to_surfaces)
list_item_4 = ListItem(List=flip_matrix, Index=0, Wrap=True)

k_means_clustering_2 = KMeansClustering(TrainingInputs=clean_tree, OfClusters=amount_of_colors_for_colors, RandomSeed=3)  # -> Result, Likelihood, Centroids
list_item_5 = ListItem(List=k_means_clustering_2.Centroids, Index=0, Wrap=True)  # -> Item, Item1, Item2
colour_rgb_2 = ColourRGB(Alpha=255, Red=list_item_5.Item, Green=list_item_5.Item1, Blue=list_item_5.Item2)  # -> flatten(Colour)

list_item_6 = ListItem(List=k_means_clustering_2.Centroids, Index=0, Wrap=True)  # -> Item, Item1, Item2
colour_rgb_3 = ColourRGB(Alpha=255, Red=list_item_6.Item, Green=list_item_6.Item1, Blue=list_item_6.Item2)  # -> flatten(Colour)
list_item_7 = ListItem(List=colour_rgb_3, Index=k_means_clustering_2.Result, Wrap=True)

dispatch_5 = Dispatch(List=list_item_7, DispatchPattern=way_of_working)  # -> ListA, ListB

custom_preview = CustomPreview(Geometry=dispatch.ListB, Material=dispatch_2.ListB)
custom_preview_2 = CustomPreview(Geometry=dispatch_3.ListA, Material=dispatch_5.ListA)
