# Grasshopper definition Model_test.gh (Grasshopper 1.0.7)
# plug-ins: Speckle.Connector.Grasshopper

panel = Panel("https://app.speckle.systems/projects/566e6518c0/models/df97a50075/versions")
brep = Brep([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])
speckle_model_url = SpeckleModelURL(SpeckleUrl=panel, Server="https://app.speckle.systems", User="55670B0A75A244FE894D1730AABA68A0")
create_collection = CreateCollection(SubCollection1=brep)
publish = Publish(ModelLink=speckle_model_url, Collection=create_collection)
panel_2 = Panel(publish)
